% Simulink data dictionary vehicle_control.sldd

CommandBus = Simulink.Bus()
  Fx: double
  Fy: double
  Mz: double

ExecutionBus = Simulink.Bus()
  reset: boolean
  enable: boolean
  cap: double

MeasurementBus = Simulink.Bus()
  x: double[5]
  vx: double
  s: double

PredictionsBus = Simulink.Bus()
  utraj: double[120]
  xtraj: double[205]
  x1: double[5]

SolverInputBus = Simulink.Bus()
  lbx_0: double[5]
  ubx_0: double[5]
  parameter_traj: double[779]
  lh: double[195]
  uh: double[195]
  lh_0: double[5]
  uh_0: double[5]
  x_init: double[205]
  u_init: double[120]
  iter_cap: double

SolverOutputsBus = Simulink.Bus()
  u0: double[3]
  utraj: double[120]
  xtraj: double[205]
  slack_values: double[400]
  solver_status: double
  cost_value: double
  kkt_residuals: double[4]
  x1: double[5]
  cpu_time: double
  cpu_time_qp: double
  cpu_time_lin: double
  sqp_iter: double
  qp_iteration_history: double[201 1]
  residual_history: double[4 201]
  history_length: double
  lam_stage0: double[36]

TelemetryBus = Simulink.Bus()
  slack_values: double[400]
  solver_status: double
  cost_value: double
  kkt_residuals: double[4]
  cpu_time: double
  cpu_time_qp: double
  cpu_time_lin: double
  sqp_iter: double
  qp_iteration_history: double[201 1]
  residual_history: double[4 201]
  history_length: double
  lam_stage0: double[36]